# Grasshopper definition eye-tracking.gh (Grasshopper 1.0.7)

point = Point()
geometry = Geometry()
file_path = FilePath()
read_file = ReadFile(File=file_path, PerLineParse=True)
mesh_closest_point = MeshClosestPoint(Point=point, Mesh=graft(geometry))  # -> Point, Index, Parameter
distance = Distance(PointA=point, PointB=mesh_closest_point.Point)
smaller_than = SmallerThan(FirstNumber=distance, SecondNumber=Slider(1, range=-0.001..20))  # -> SmallerThan, OrEqualTo
ghpython_script = GhPythonScript(data=read_file)  # -> out, x_values, y_values, z_values; inputs data: list
# ---------- ghpython_script: Python ----------
__author__ = "armstrong"
__version__ = "2025.06.01"

import rhinoscriptsyntax as rs

# 将列表中的所有行连接成一个字符串
data_string = '\n'.join(data)
 
# 分割数据行
lines = data_string.strip().split('\n')
 
# 初始化列表来存储x, y, z
x_values = []
y_values = []
z_values = []
 
# 跳过第一行（标题行），然后处理每一行数据
for line in lines[1:]:
    # 分割每行的数据
    x, y, z = line.split(',')
    
    # 将数据添加到相应的列表中
    x_values.append(x)
    y_values.append(y)
    z_values.append(z)
 
# 打印结果
print("x values:", x_values)
print("y values:", y_values)
print("z values:", z_values)
# ---------- end ghpython_script ----------
panel = Panel(read_file)
negative = Negative(Value=ghpython_script.y_values)
dispatch = Dispatch(List=mesh_closest_point.Point, DispatchPattern=smaller_than.SmallerThan)  # -> ListA, ListB
panel_2 = Panel(ghpython_script.x_values)
list_length = ListLength(List=dispatch.ListA)
construct_point = ConstructPoint(XCoordinate=ghpython_script.x_values, YCoordinate=negative, ZCoordinate=ghpython_script.z_values)
panel_3 = Panel(dispatch.ListA)
panel_4 = Panel(list_length)
